% Simulink design studies setup_multiple_simulations.mldatx for model MPOBRsys_with_model

study "DesignStudy_1-9": 9 simulations
  combinatorial set ( points):
    "Variable_1": Variable(Name=f20), values [0.5 1 1.5] (3 points)
    "Variable_2": Variable(Name=f10), values [1 3 5] (3 points)

study "DesignStudy_10_18": 9 simulations (not selected)
  combinatorial set ( points):
    "Variable_1": Variable(Name=f21), values [0.5 1 1.5] (3 points)
    "Variable_2": Variable(Name=f10), values [1 3 5] (3 points)

study "DesignStudy_19_27": 9 simulations (not selected)
  combinatorial set ( points):
    "Variable_1": Variable(Name=f22), values [0.5 1 1.5] (3 points)
    "Variable_2": Variable(Name=f10), values [1 3 5] (3 points)

study "DesignStudy_28_36": 9 simulations (not selected)
  combinatorial set ( points):
    "Variable_1": Variable(Name=f20), values [0.5 1 1.5] (3 points)
    "Variable_2": Variable(Name=f11), values [1 3 5] (3 points)

study "DesignStudy_37_45": 9 simulations (not selected)
  combinatorial set ( points):
    "Variable_1": Variable(Name=f21), values [0.5 1 1.5] (3 points)
    "Variable_2": Variable(Name=f11), values [1 3 5] (3 points)

study "DesignStudy_46_54": 9 simulations (not selected)
  combinatorial set ( points):
    "Variable_1": Variable(Name=f22), values [0.5 1 1.5] (3 points)
    "Variable_2": Variable(Name=f11), values [1 3 5] (3 points)

study "DesignStudy_55_63": 9 simulations (not selected)
  combinatorial set ( points):
    "Variable_1": Variable(Name=f20), values [0.5 1 1.5] (3 points)
    "Variable_2": Variable(Name=f12), values [1 3 5] (3 points)

study "DesignStudy_62_72": 9 simulations (not selected)
  combinatorial set ( points):
    "Variable_1": Variable(Name=f21), values [0.5 1 1.5] (3 points)
    "Variable_2": Variable(Name=f12), values [1 3 5] (3 points)

study "DesignStudy_73_81": 9 simulations (not selected)
  combinatorial set ( points):
    "Variable_1": Variable(Name=f22), values [0.5 1 1.5] (3 points)
    "Variable_2": Variable(Name=f12), values [1 3 5] (3 points)